# Dynamo graph script.dyn "UnHide Markup in Views on Sheets" (Dynamo 2.18.1.5096)
# packages: archi-lab.net 2024.217.1024

# group: Select All views on all Sheets
categories = Categories("OST_Sheets")
all_elements_of_category = ElementsOfCategory(Category=categories)
views = Sheet.Views(sheet=all_elements_of_category)
flatten = List.Flatten(list=views)

# group: Select Dimension Type
categories_2 = Categories("OST_Dimensions")
all_elements_of_category_2 = ElementsOfCategory(Category=categories_2)
code_block = CodeBlock { "HN Metric Dimension - temporarily"; }
filterByName = archilab.Revit.Elements.Elements.FilterByName(elements=all_elements_of_category_2, searchString=code_block)

# group: Select Line Style Type
categories_3 = Categories("OST_Lines")
all_elements_of_category_3 = ElementsOfCategory(Category=categories_3)
code_block_2 = CodeBlock { "Line Style"; }
getParameterValueByName = Element.GetParameterValueByName(element=all_elements_of_category_3, parameterName=code_block_2)
name = Element.Name(element=getParameterValueByName)
string = StringInput("MS - Red Line")
contains = String.Contains(string=name, searchFor=string)
filterByBoolMask = List.FilterByBoolMask(list=all_elements_of_category_3, mask=contains)

# group: Combine List
watch = Watch(filterByName.in)
watch_2 = Watch(filterByBoolMask.in)
list_create = List.Create(item0=watch, item1=watch_2)
flatten_2 = List.Flatten(list=list_create)

unHideElements = archilab.Revit.Views.Views.UnHideElements(view=flatten, elements=flatten_2)
